# Grasshopper definition staircase.gh (Grasshopper 1.0.7)
# plug-ins: Human

trimming_plane_x_coordinate = Slider(0.17, range=0..1)
number = Number(trimming_plane_x_coordinate)

# ---- group: chord curve offsets
outer = Slider(0.5, range=0..1)
negative = Negative(Value=Slider(0.75, range=0..1))
number_2 = Number(negative)
number_3 = Number(outer)

# ---- group: chord curve z displacement
outer_2 = Slider(0, range=0..1)
negative_2 = Negative(Value=Slider(0.3, range=0..1))
negative_3 = Negative(Value=outer_2)
number_4 = Number(negative_2)
number_5 = Number(negative_3)

# ----
step_width = Slider(1, range=0..1)
step_height = Slider(0.15, range=0..1)
number_6 = Number(step_width)
number_7 = Number(step_height)

number_8 = Number(number_6)
number_9 = Number(number_7)
construct_point = ConstructPoint(XCoordinate=0, YCoordinate=0, ZCoordinate=0)
division = Division(A=number_8, B="2")
point = Point(construct_point)
unit_z = UnitZ(Factor=number_9)
unit_x = UnitX(Factor=division)
# 1a. Solve constrained form-finding problem of one staircase step to accelerate convergence
point_2 = Point(point)
reverse = Reverse(Vector=unit_x)
entwine = Entwine(Branch00=unit_x, Branch01=reverse, FlattenInputs=True)
move = Move(Geometry=point_2, Motion=entwine)  # -> Geometry, Transform
move_2 = Move(Geometry=move.Geometry, Motion=unit_z)  # -> Geometry, Transform
point_3 = Point(move_2.Geometry)
point_4 = Point(point_3)
point_5 = Point(point)
entwine_2 = Entwine(Branch00=point_4, Branch01=point_5, FlattenInputs=True)  # -> flatten(Result)
polyline = PolyLine(Vertices=entwine_2, Closed="True")
curve = Curve(polyline)

# ---- group: Deviation edge forces / Load
node_load_kn = Slider(0.5, range=0..1)
num = Number(node_load_kn)

# ----
curve_2 = Curve(curve)
num_2 = Number(num)
explode = Explode(Curve=curve_2, Recursive=True)  # -> Segments, Vertices
value_list = ValueList({"Tension": 1, "Compression": -1}, selected="Tension")
value_list_2 = ValueList({"Tension": 1, "Compression": -1}, selected="Compression")
list_item = ListItem(List=explode.Segments, Index=0, Wrap=True)  # -> Item, Item1, Item2
entwine_3 = Entwine(Branch00=value_list, Branch01=value_list_2, FlattenInputs=True)
unit_z_2 = UnitZ(Factor=num_2)
entwine_4 = Entwine(Branch00=list_item.Item, Branch01=[list_item.Item1, list_item.Item2], FlattenInputs=True)
end_points = EndPoints(Curve=list_item.Item)  # -> Start, End
multiplication = Multiplication(A="0.5", B=entwine_3)
reverse_2 = Reverse(Vector=unit_z_2)
deviationedge = DeviationEdge(line=entwine_4, force=multiplication)  # -> deviation_edge; inputs line: Line
#   port line: A line that defines the end nodes of the edge.
#   port force: The desired force on the edge. If negative, the edge is in compression. Otherwise, it is in tension.
#   port deviation_edge: A COMPAS CEM deviation edge.
# ---------- deviationedge: Python ----------
"""
Create a deviation edge from a line.
"""
from ghpythonlib.componentbase import executingcomponent as component

from compas_cem.elements import DeviationEdge

from compas_rhino.geometry import RhinoLine


class DeviationEdgeComponent(component):
    def RunScript(self, line, force):
        if not line or force is None:
            return
        line = RhinoLine.from_geometry(line).to_compas()
        return DeviationEdge.from_line(line, force=force)
# ---------- end deviationedge ----------
nodeload = NodeLoad(point=[end_points.Start, end_points.End], vector=reverse_2)  # -> node_load; inputs point: Point3d, vector: Vector3d
#   port point: The position of the node where to apply the load.
#   port vector: The load vector.
#   port node_load: A COMPAS CEM node load.
# ---------- nodeload: Python ----------
"""
Create a load vector to be applied at a node.
"""
from ghpythonlib.componentbase import executingcomponent as component

from compas_rhino.geometry import RhinoPoint
from compas_rhino.geometry import RhinoVector

from compas_cem.loads import NodeLoad


class NodeLoadComponent(component):
    def RunScript(self, point, vector):
        if not (point and vector):
            return

        point = RhinoPoint.from_geometry(point).to_compas()
        vector = RhinoVector.from_geometry(vector).to_compas()

        return NodeLoad.from_point_and_vector(point, vector)
# ---------- end nodeload ----------
assembletopologydiagram = AssembleTopologyDiagram(deviation_edges=flatten(deviationedge), loads=flatten(nodeload), add_auxiliary_trails=Toggle(True))  # -> topology; inputs trail_edges: list, deviation_edges: list, loads: list, supports: list, add_auxiliary_trails: Boolean
#   port trail_edges: The COMPAS CEM trail edges to add to the diagram.
#   port deviation_edges: The COMPAS CEM deviation edges to add to the diagram.
#   port loads: The COMPAS CEM loads to add to the diagram.
#   port supports: The COMPAS CEM supports to add to the diagram.
#   port add_auxiliary_trails: Append auxiliary trails to the free nodes of the topology diagram. Defaults to False.
#   port topology: A COMPAS CEM topology diagram.
# ---------- assembletopologydiagram: Python ----------
"""
Assemble a topology diagram.
"""
from ghpythonlib.componentbase import executingcomponent as component

from compas_cem.diagrams import TopologyDiagram


class AssembleTopologyDiagramComponent(component):
    def RunScript(self, trail_edges, deviation_edges, loads, supports, add_auxiliary_trails):

        add_auxiliary_trails = add_auxiliary_trails or False
        topology = TopologyDiagram()

        if trail_edges:
            for trail_edge in trail_edges:
                if trail_edge:
                    topology.add_edge(trail_edge)

        if deviation_edges:
            for deviation_edge in deviation_edges:
                if deviation_edge:
                    topology.add_edge(deviation_edge)

        if loads:
            for load in loads:
                if load:
                    topology.add_load(load)

        if supports:
            for support in supports:
                if support:
                    topology.add_support(support)

        if trail_edges and supports:
            topology.build_trails(add_auxiliary_trails)

        elif deviation_edges and add_auxiliary_trails:
            topology.build_trails(add_auxiliary_trails)

        return topology
# ---------- end assembletopologydiagram ----------
data = Data(assembletopologydiagram)

curve_3 = Curve(curve)
data_2 = Data(data)
explode_2 = Explode(Curve=curve_3, Recursive=True)  # -> Segments, Vertices
topologydisassembly = DisassembleTopologyDiagram(topology=data_2)  # -> node_keys, origin_node_keys, support_node_keys, edge_keys, trail_edge_keys, deviation_edge_keys, trail_keys, auxiliary_trail_keys
#   port topology: A COMPAS CEM topology diagram.
#   port node_keys: All the node keys in the topology diagram.
#   port origin_node_keys: The keys of the origin nodes in the topology diagram.
#   port support_node_keys: The keys of the support nodes in the topology diagram.
#   port edge_keys: All the edge keys in the topology diagram.
#   port trail_edge_keys: The keys of the trail edges in the topology diagram.
#   port deviation_edge_keys: The keys of the deviation edges in the topology diagram.
#   port trail_keys: The keys of the trails in the topology diagram.
#   port auxiliary_trail_keys: The keys of the auxiliary trails in the topology diagram.
# ---------- topologydisassembly: Python ----------
"""
Disassemble a topology diagram into its constituent parts.
"""
from ghpythonlib.componentbase import executingcomponent as component


class TopologyDisassemblyComponent(component):
    def RunScript(self, topology):
        if not topology:
            return

        trail_keys = list(topology.trails())
        auxiliary_trail_keys = list(topology.auxiliary_trails())

        edge_keys = list(topology.edges())
        trail_edge_keys = list(topology.trail_edges())
        deviation_edge_keys = list(topology.deviation_edges())

        node_keys = list(topology.nodes())
        origin_node_keys = list(topology.origin_nodes())
        support_node_keys = list(topology.support_nodes())

        return node_keys, origin_node_keys, support_node_keys, edge_keys, trail_edge_keys, deviation_edge_keys, trail_keys, auxiliary_trail_keys
# ---------- end topologydisassembly ----------
item = ListItem(List=explode_2.Vertices, Index="2", Wrap=True)
searchnodekey = SearchNodeKey(diagram=data_2, point=item)  # -> node_key; inputs point: Point3d
#   port diagram: A COMPAS CEM topology or form diagram.
#   port point: The point to search for in the diagram.
#   port node_key: The found node key.
# ---------- searchnodekey: Python ----------
"""
Search a node key in a topology or a form diagram using a point.
"""
from ghpythonlib.componentbase import executingcomponent as component

from compas.utilities import geometric_key
from compas_rhino.geometry import RhinoPoint


class SearchNodeKeyComponent(component):
    def RunScript(self, diagram, point):
        if not (point and diagram):
            return

        pt = RhinoPoint.from_geometry(point).to_compas()
        gkey = geometric_key(pt, diagram.tol)

        return diagram.gkey_node[gkey]
# ---------- end searchnodekey ----------
python = GhPythonScript(auxiliary_trail_keys=topologydisassembly.auxiliary_trail_keys, node_key=searchnodekey)  # -> out, auxiliary_trail_keys; inputs auxiliary_trail_keys: list
# ---------- python: Python ----------
aux = []

for u, v in auxiliary_trail_keys:
    if u == node_key or v == node_key:
        continue
    aux.append(tuple([u, v]))

auxiliary_trail_keys = aux
# ---------- end python ----------
deviationedgeforceparameter = DeviationEdgeForceParameter(edge_key=topologydisassembly.deviation_edge_keys, bound_low="2.0", bound_up="2.0")  # -> parameter
#   port edge_key: The key of a COMPAS CEM deviation edge.
#   port bound_low: The lower bound of the edge optimization parameter. Its value is calculated as the initial edge parameter minus the absolute value of this bound.
#   port bound_up: The upper bound of the edge optimization parameter. Its value is calculated as the initial edge parameter plus the absolute value of this bound.
#   port parameter: A COMPAS CEM deviation edge force parameter.
# ---------- deviationedgeforceparameter: Python ----------
"""
Set the force of a deviation edge as an optimization parameter.
"""
from ghpythonlib.componentbase import executingcomponent as component

from compas_cem.optimization import DeviationEdgeParameter


class DeviationEdgeParameterComponent(component):
    def RunScript(self, edge_key, bound_low, bound_up):
        if not edge_key or bound_low is None or bound_up is None:
            return

        return DeviationEdgeParameter(edge_key, bound_low, bound_up)
# ---------- end deviationedgeforceparameter ----------
trailedgeforceconstraint = TrailEdgeForceConstraint(edge_key=python.auxiliary_trail_keys, force="0.0")  # -> constraint
#   port edge_key: The key of a COMPAS CEM trail edge.
#   port force: The target force.
#   port weight: The weight of the constraint in the optimization problem. Defaults to one.
#   port constraint: A COMPAS CEM trail force constraint.
# ---------- trailedgeforceconstraint: Python ----------
"""
Make the force on a trail edge to reach a prescribed value.
"""
from ghpythonlib.componentbase import executingcomponent as component

from compas_cem.optimization import TrailEdgeForceConstraint


class TrailEdgeForceConstraintComponent(component):
    def RunScript(self, edge_key, force, weight):
        weight = weight or 1.0
        if not edge_key or force is None:
            return
        return TrailEdgeForceConstraint(edge_key, force, weight)
# ---------- end trailedgeforceconstraint ----------
constrainedformfinding = ConstrainedFormFinding(
    solve=Toggle(True),
    topology=data_2,
    constraints=trailedgeforceconstraint,
    parameters=deviationedgeforceparameter,
    algorithm="LBFGS")  # -> topology, form, objective, grad_norm, iters, time, status; inputs solve: Boolean, constraints: list, parameters: list, iters_max: Int32, tmax: Int32
#   port solve: Kickstarts the solution of the constrained form-finding problem.
#   port topology: A COMPAS CEM topology diagram.
#   port constraints: A list of COMPAS CEM optimization constraints.
#   port parameters: A list of COMPAS CEM optimization parameters.
#   port algorithm: The name of the gradient-based local optimization algorithm to use. Defaults to SLSQP. Currently supported algorithms are: - SLSQP: Sequential Least Squares Programming - LBFGS: Low-Storage Broyden-Fletcher-Goldfarb-Shanno - AUGLAG: Augmented Lagrangian - MMA: Method of Moving Asymptotes - TNEWTON: Preconditioned Truncated Newton
#   port iters_max: The maximum number of iterations to run the optimization algorithm for. If it is equal to -1, then there is no iteration limit. Defaults to 100.
#   port eps: The minimum objective or norm of the gradient to declare convergence. Defaults to 1e-6.
#   port tmax: The maximum number of iterations to run the form-finding algorithm for. Defaults to 100.
#   port eta: The convergence threshold of the form-finding algorithm. Defaults to 1e-6.
#   port topology: A COMPAS CEM topology diagram with optimized parameters.
#   port form: A COMPAS CEM form diagram in static equilibrium.
#   port objective: The resulting output value of the objective function.
#   port grad_norm: The norm of the gradient of the objective function.
#   port iters: The elapsed number of optimization iterations.
#   port time: The total optimization runtime in seconds.
#   port status: The final status of the optimization process.
# ---------- constrainedformfinding: Python ----------
"""
Generate a form diagram in static equilibrium such that it meets user-defined constraints.
"""
from ghpythonlib.componentbase import executingcomponent as component
from scriptcontext import sticky

from compas.rpc import Proxy


class ConstrainedFormFindingComponent(component):
    def RunScript(self, solve, topology, constraints, parameters, algorithm, iters_max, eps, tmax, eta):
        algorithm = algorithm or "SLSQP"
        iters_max = iters_max or 100
        eps = eps or 1e-6
        tmax = tmax or 100
        eta = eta or 1e-6

        if not (solve and topology and constraints and parameters):
            return

        topology = topology.copy()

        # clean constraints and parameters from None
        constraints = [c for c in constraints if c is not None]
        parameters = [p for p in parameters if p is not None]

        # fetch optimization proxy from scriptcontext
        opt = sticky.get("proxy_cem")
        proxy_temp_exists = False

        # create temporary proxy server if unavailable from scriptcontext
        if not opt:
            opt = Proxy("compas_cem.optimization")
            proxy_temp_exists = False

        # solve constrained form-finding problem
        solution = opt.solve_proxy(topology=topology,
                                   constraints=constraints,
                                   parameters=parameters,
                                   algorithm=algorithm,
                                   iters=iters_max,
                                   eps=eps,
                                   tmax=tmax,
                                   eta=eta)

        # shut down temporary proxy
        if proxy_temp_exists:
            opt.stop_server()

        # unpack solution
        topology, form, objective, grad_norm, iters, time, status = solution

        return topology, form, objective, grad_norm, iters, time, status
# ---------- end constrainedformfinding ----------
panel = Panel(constrainedformfinding.objective)
panel_2 = Panel(constrainedformfinding.iters)
panel_3 = Panel(constrainedformfinding.status)
panel_4 = Panel(constrainedformfinding.time)
panel_5 = Panel(constrainedformfinding.grad_norm)
data_3 = Data(constrainedformfinding.form)
data_4 = Data(data_2)
data_5 = Data(data_3)
topologydisassembly_2 = DisassembleTopologyDiagram(topology=data_4)  # -> node_keys, origin_node_keys, support_node_keys, edge_keys, trail_edge_keys, deviation_edge_keys, trail_keys, auxiliary_trail_keys; same code as topologydisassembly
edgeforceslengths = EdgeForcesAndLengths(form=data_5, edge_keys=topologydisassembly_2.deviation_edge_keys)  # -> lengths, forces; inputs edge_keys: list
#   port form: A COMPAS CEM form diagram.
#   port edge_keys: A selection of edge keys to query the results on. Defaults to all the edge keys.
#   port lengths: The edge lengths.
#   port forces: The edge forces.
# ---------- edgeforceslengths: Python ----------
"""
Get the lengths and forces of the edges in a form diagram.
"""
from ghpythonlib.componentbase import executingcomponent as component


class EdgeResultsComponent(component):
    def RunScript(self, form, edge_keys):
        if not form:
            return

        edge_keys = edge_keys or list(form.edges())
        lengths = [form.edge_length_2(ed) for ed in edge_keys]
        forces = [form.edge_force(ed) for ed in edge_keys]

        return lengths, forces
# ---------- end edgeforceslengths ----------
panel_6 = Panel(edgeforceslengths.forces)
number_10 = Number(edgeforceslengths.forces)

# ---- group: Deviation edge forces / interior chord
value_list_3 = ValueList({"Tension": 1, "Compression": -1}, selected="Compression")
number_slider = Slider(6, range=0..20)

# ---- group: Deviation edge forces / exterior chord
value_list_4 = ValueList({"Tension": 1, "Compression": -1}, selected="Tension")
number_slider_2 = Slider(6, range=0..20)

# ---- group: Deviation edge forces / interior lateral strut
value_list_5 = ValueList({"Tension": 1, "Compression": -1}, selected="Compression")
number_slider_3 = Slider(1, range=0..5)

# ---- group: Deviation edge forces / exterior lateral strut
value_list_6 = ValueList({"Tension": 1, "Compression": -1}, selected="Compression")
number_slider_4 = Slider(1, range=0..5)

# ----
bake_geometry = BakeGeometry(Bake=<missing>, Geometry=<missing>, Attributes=<missing>, DeleteOldBakes=False, PreserveTrees=False)

# ---- group: Deviation edge forces
entwine_5 = Entwine(Branch00=number_slider, Branch01=number_slider_2, FlattenInputs=True)
entwine_6 = Entwine(Branch00=number_slider_3, Branch01=number_slider_4, FlattenInputs=True)
entwine_7 = Entwine(Branch00=value_list_5, Branch01=value_list_6, FlattenInputs=True)
entwine_8 = Entwine(Branch00=value_list_3, Branch01=value_list_4, FlattenInputs=True)
multiplication_2 = Multiplication(A=entwine_6, B=entwine_7)
number_11 = Number(entwine_5)
number_12 = Number(entwine_8)
number_13 = Number(multiplication_2)

# ----
optimization_algorithm = ValueList({"LBFGS", "SLSQP"}, selected="LBFGS")
text = Text(optimization_algorithm)

max_iters = Slider(500, range=0..1000)
integer = Integer(max_iters)

# ---- group: Proxy server
proxyserver = ProxyServer(start=Toggle(True), stop=Toggle(False))  # inputs start: Boolean, stop: Boolean
#   port start: Launch the COMPAS CEM proxy server. The proxy is kept open to be re-used and thus save start up time.
#   port stop: Shut down the proxy server.
# ---------- proxyserver: Python ----------
"""
Create an RPC proxy server to solve a constrained form-finding problem via CPython
"""
from ghpythonlib.componentbase import executingcomponent as component

from scriptcontext import sticky

from compas.rpc import Proxy
from compas_cem import PROXY_PORT


class CEMProxyComponent(component):
    def RunScript(self, start, stop):

        if not (start or stop):
            return

        if start:
            proxy = Proxy("compas_cem.optimization", port=PROXY_PORT)
            sticky["proxy_cem"] = proxy

        if stop:
            proxy = Proxy(port=PROXY_PORT)
            proxy.stop_server()
            if "proxy_cem" in sticky:
                del sticky["proxy_cem"]
# ---------- end proxyserver ----------

# ----
bake_geometry_2 = BakeGeometry(Bake=<missing>, Geometry=<missing>, Attributes=<missing>, DeleteOldBakes=False, PreserveTrees=False)

value_list_7 = ValueList({"Forces": 0, "Lengths": 1}, selected="Forces")
load_min = Slider(0.001, range=0..0.001)
lineweight_thickness_factor = Slider(0.2, range=0..10)
reaction_scale = Slider(0.02, range=0..1)
load_scale = Slider(0.5, range=0..1)
number_14 = Number(lineweight_thickness_factor)
integer_2 = Integer(value_list_7)
number_15 = Number(reaction_scale)
number_16 = Number(load_min)

load_min_2 = Slider(0.001, range=0..0.001)
dash_length = Slider(0.04, range=0..0.1)
sphere_radius = Slider(0.03, range=0..0.1)
load_scale_2 = Slider(1, range=0..1)
number_17 = Number(load_scale_2)
number_18 = Number(load_min_2)
# 4. Visualization
number_19 = Number(dash_length)
number_20 = Number(sphere_radius)

offset_z = Slider(0.24, range=0..1)
origin_point_z_coordinate = Slider(0.0815, range=0..0.1)
circle_radius = Slider(1.5, range=0..10)
segments_half_circle = Slider(17, range=0..100)
target_height = Slider(3, range=0..10)
integer_3 = Integer(segments_half_circle)
number_21 = Number(circle_radius)
number_22 = Number(target_height)

addition = Addition(A=offset_z, B=origin_point_z_coordinate)

number_23 = Number(addition)

number_24 = Number(number_21)
number_25 = Number(number_23)
# 1. Create staircase geometry (chords and lower half of steps)
construct_point_2 = ConstructPoint(XCoordinate=0, YCoordinate=0, ZCoordinate=number_25)
circle_cnr = CircleCNR(Center=construct_point_2, Normal=Vector(0, 0, 1), Radius=number_24)
curve_4 = Curve(circle_cnr)

integer_4 = Integer(integer_3)
number_26 = Number(number_22)
curve_5 = Curve(curve_4)
integer_5 = Integer(integer_3)
multiplication_3 = Multiplication(A=integer_5, B=2)
range = Range(Domain=Domain(0, 1), Steps=integer_4)
divide_curve = DivideCurve(Curve=curve_5, Count=multiplication_3, Kinks=False)  # -> Points, Tangents, Parameters
multiplication_4 = Multiplication(A=number_26, B=range)
point_6 = Point(divide_curve.Points)
number_27 = Number(multiplication_4)
number_28 = Number(number_2)
number_29 = Number(number_3)
point_7 = Point(point_6)
entwine_9 = Entwine(Branch00=number_28, Branch01=number_29, FlattenInputs=True)
polyline_2 = PolyLine(Vertices=point_7, Closed=True)
insert_items = InsertItems(List=entwine_9, Item="0", Indices="0", Wrap=True)
offset_curve = OffsetCurve(Curve=polyline_2, Distance=insert_items, Plane=PlaneXY(0, 0, 0), Corners=1)
curve_6 = Curve(offset_curve)
curve_7 = Curve(polyline_2)

curve_8 = Curve(curve_6)
number_30 = Number(number_4)
number_31 = Number(number_5)
number_32 = Number(number_27)
integer_6 = Integer(integer_3)
control_points = ControlPoints(Curve=curve_8)  # -> simplify(Points), Weights, Knots
entwine_10 = Entwine(Branch00=number_30, Branch01=number_31, FlattenInputs=True)
addition_2 = Addition(A=integer_6, B=1)
insert_items_2 = InsertItems(List=entwine_10, Item="0", Indices="0", Wrap=True)
reverse_list = ReverseList(List=control_points.Points)
series = Series(Start=0, Step=1, Count=addition_2)
addition_3 = Addition(A=number_32, B=graft(insert_items_2))
unit_z_3 = UnitZ(Factor=addition_3)
list_item_2 = ListItem(List=reverse_list, Index=series, Wrap=True)
move_3 = Move(Geometry=list_item_2, Motion=unit_z_3)  # -> Geometry, Transform
polyline_3 = PolyLine(Vertices=move_3.Geometry, Closed=False)  # -> simplify(Polyline)
rotate = Rotate(Geometry=polyline_3, Angle=-1.570796327, Plane=PlaneXY(0, 0, 0))  # -> Geometry, Transform
curve_9 = Curve(rotate.Geometry)

curve_10 = Curve(curve_7)
explode_3 = Explode(Curve=curve_10, Recursive=True)  # -> Segments, Vertices
length = Length(Curve=explode_3.Segments)
average = Average(Input=length)
number_33 = Number(average)

number_34 = Number(number_33)
curve_11 = Curve(curve_9)
number_35 = Number(number)
construct_point_3 = ConstructPoint(XCoordinate=number_35, YCoordinate=0, ZCoordinate=0)
extend_curve = ExtendCurve(Curve=curve_11, Type=0, Start=number_34, End=number_34)
yz_plane = YZPlane(Origin=construct_point_3)
curve_plane = CurvePlane(Curve=extend_curve, Plane=yz_plane)  # -> Points, ParamsC, ParamsP
shatter = Shatter(Curve=extend_curve, Parameters=curve_plane.ParamsC)
list_item_3 = ListItem(List=shatter, Index="1", Wrap=True)
match_tree = MatchTree(Tree=list_item_3, Guide=curve_11)
curve_12 = Curve(match_tree)

crv = Curve(curve_12)
number_36 = Number(number)
number_37 = Number(number_21)
crv_2 = Curve(crv)
number_38 = Number(number_3)
addition_4 = Addition(A=number_37, B=number_38)
neg = Negative(Value=number_36)
project = Project(Geometry=crv, Plane=PlaneXY(0, 0, 0))  # -> Geometry, Transform
bbox = BoundingBox(Content=flatten(project.Geometry), Plane=PlaneXY(0, 0, 0), UnionBox=True)  # -> Box, Box_2
boxprop = BoxProperties(Box=bbox.Box)  # -> Center, Diagonal, Area, Volume, Degeneracy
pdecon = Deconstruct(Point=boxprop.Diagonal)  # -> XComponent, YComponent, ZComponent
division_2 = Division(A=pdecon.YComponent, B=2)
subtraction = Subtraction(A=division_2, B=addition_4)
subtraction_2 = Subtraction(A=addition_4, B=subtraction)
vec = VectorXYZ(XComponent=neg, YComponent=subtraction_2, ZComponent=0)  # -> Vector, Length
move_4 = Move(Geometry=crv, Motion=vec.Vector)  # -> Geometry, Transform
curve_13 = Curve(move_4.Geometry)

curve_14 = Curve(curve_13)
split_tree = SplitTree(Data=curve_14, Masks=flatten("{0;*}"))  # -> Positive, Negative
reverse_list_2 = ReverseList(List=flatten(split_tree.Positive))  # -> graft(List)
match_tree_2 = MatchTree(Tree=reverse_list_2, Guide=split_tree.Positive)
merge = Merge(Data1=split_tree.Negative, Data2=match_tree_2)
curve_15 = Curve(merge)
curve_16 = Curve(curve_15)
control_points_2 = ControlPoints(Curve=curve_16)  # -> Points, Weights, Knots
graft_tree = GraftTree(Tree=control_points_2.Points, IncludeEmptyLists=True, IncludeNullItems=True)  # -> simplify(Tree)
path_mapper = PathMapper(graft_tree, source="{A;B;C}", target="{C}")
panel_7 = Panel("""0
-1""")
tree_statistics = TreeStatistics(Tree=path_mapper)  # -> Paths, Length, Count
cull_index = CullIndex(List=tree_statistics.Paths, Indices=panel_7, Wrap=True)
split_tree_2 = SplitTree(Data=path_mapper, Masks=flatten(cull_index))  # -> Positive, Negative
polyline_4 = PolyLine(Vertices=split_tree_2.Positive, Closed=False)
polyline_5 = PolyLine(Vertices=path_mapper, Closed=False)
planar = Planar(Curve=polyline_5)  # -> flatten(Planar), Plane, Deviation
planar_2 = Planar(Curve=polyline_4)  # -> flatten(Planar), Plane, Deviation
plane = Plane(planar_2.Plane)
curve_17 = Curve(polyline_4)
plane_2 = Plane(planar.Plane)

curve_18 = Curve(curve_13)
split_tree_3 = SplitTree(Data=curve_18, Masks=flatten("{*;0}"))  # -> Positive, Negative
curve_19 = Curve(split_tree_3.Negative)

curve_20 = Curve(curve_19)
explode_4 = Explode(Curve=curve_20, Recursive=True)  # -> Segments, Vertices
curve_21 = Curve(explode_4.Segments)
list_length = ListLength(List=curve_21)
integer_division = IntegerDivision(A=list_length, B="2")
cull_index_2 = CullIndex(List=curve_21, Indices=integer_division, Wrap=True)
list_item_4 = ListItem(List=curve_21, Index=integer_division, Wrap=True)
curve_22 = Curve(cull_index_2)
curve_23 = Curve(list_item_4)
curve_24 = Curve(cull_index_2)

curve_25 = Curve(curve_19)
end_points_2 = EndPoints(Curve=curve_25)  # -> Start, End
point_8 = Point([end_points_2.Start, end_points_2.End])

curve_26 = Curve(curve_17)
explode_5 = Explode(Curve=curve_26, Recursive=True)  # -> Segments, Vertices
flip_matrix = FlipMatrix(Data=explode_5.Segments)
curve_27 = Curve(flip_matrix)

curve_28 = Curve(curve_17)
plane_3 = Plane(plane)
explode_6 = Explode(Curve=curve_28, Recursive=True)  # -> Segments, Vertices
deconstruct_plane = DeconstructPlane(Plane=plane_3)  # -> Origin, XAxis, YAxis, ZAxis
list_item_5 = ListItem(List=explode_6.Vertices, Index="1", Wrap=True)
unit_z_4 = UnitZ(Factor=1)
construct_plane = ConstructPlane(Origin=list_item_5, XAxis=deconstruct_plane.ZAxis, YAxis=unit_z_4)
plane_4 = Plane(construct_plane)
yz_plane_2 = YZPlane(Origin=Point(0, 0, 0))
curve_29 = Curve(curve)
plane_5 = Plane(plane_4)
orient = Orient(Geometry=curve_29, Source=yz_plane_2, Target=plane_5)  # -> Geometry, Transform
curve_30 = Curve(orient.Geometry)
curve_31 = Curve(curve_30)
number_39 = Number(number_10)
explode_7 = Explode(Curve=curve_31, Recursive=True)  # -> Segments, Vertices
deviationedge_2 = DeviationEdge(line=explode_7.Segments, force=number_39)  # -> deviation_edge; inputs line: Line; same code as deviationedge
list_item_6 = ListItem(List=explode_7.Segments, Index=0, Wrap=True)
curve_32 = Curve(list_item_6)
curve_33 = Curve(explode_7.Segments)
data_6 = Data(deviationedge_2)

plane_6 = Plane(flatten(plane_2))
curve_34 = Curve(curve_24)
join_curves = JoinCurves(Curves=curve_34, Preserve=False)
list_item_7 = ListItem(List=join_curves, Index=0, Wrap=True)  # -> Item, Item1
flip_curve = FlipCurve(Curve=list_item_7.Item)  # -> Curve, Flag
merge_2 = Merge(Data1=flip_curve.Curve, Data2=list_item_7.Item1)
explode_8 = Explode(Curve=merge_2, Recursive=True)  # -> Segments, Vertices
graft_tree_2 = GraftTree(Tree=explode_8.Segments, IncludeEmptyLists=True, IncludeNullItems=True)
curve_35 = Curve(graft_tree_2)
curve_36 = Curve(curve_35)
end_points_3 = EndPoints(Curve=curve_36)  # -> Start, End
point_9 = Point(end_points_3.End)
deconstruct_plane_2 = DeconstructPlane(Plane=plane_6)  # -> Origin, XAxis, YAxis, ZAxis
plane_closest_point = PlaneClosestPoint(Point=end_points_3.End, Plane=flatten(plane_6))  # -> Point, UVPoint, Distance
closest_point = ClosestPoint(Point=end_points_3.End, Cloud=deconstruct_plane_2.Origin)  # -> ClosestPoint, CPIndex, Distance
absolute = Absolute(Value=plane_closest_point.Distance)
addition_5 = Addition(A=closest_point.Distance, B=absolute)
sort_list = SortList(Keys=addition_5, ValuesValuesA=plane_6, ValuesA=plane_closest_point.Point)  # -> Keys, ValuesValuesA, ValuesA
panel_8 = Panel(closest_point.Distance)
list_item_8 = ListItem(List=sort_list.ValuesValuesA, Index=0, Wrap=True)
curve_37 = Curve(curve_35)
plane_7 = Plane(list_item_8)

number_40 = Number(number_12)
curve_38 = Curve(curve_35)
path_mapper_2 = PathMapper(curve_38, source="{A;B;C;D;E;F;G}", target="{A}")
tree_statistics_2 = TreeStatistics(Tree=path_mapper_2)  # -> Paths, Length, Count
repeat_data = RepeatData(Data=number_40, Length=graft(tree_statistics_2.Length))
match_tree_3 = MatchTree(Tree=graft(repeat_data), Guide=curve_38)
number_41 = Number(match_tree_3)

# ----
# 2. Assemble global topology diagram of the staircase
curve_39 = Curve(curve_35)
plane_8 = Plane(plane_7)
number_42 = Number(number_41)
split_tree_4 = SplitTree(Data=curve_39, Masks=flatten("{1;*}"))  # -> Positive, Negative
split_tree_5 = SplitTree(Data=plane_8, Masks=flatten("{1;*}"))  # -> Positive, Negative
split_tree_6 = SplitTree(Data=number_42, Masks=flatten("{1;*}"))  # -> Positive, Negative
curve_40 = Curve(split_tree_4.Positive)
curve_41 = Curve(split_tree_4.Negative)
plane_9 = Plane(split_tree_5.Positive)
number_43 = Number(split_tree_6.Positive)
number_44 = Number(split_tree_6.Negative)
plane_10 = Plane(split_tree_5.Negative)

curve_42 = Curve(curve_32)
num_3 = Number(num)
negative_4 = Negative(Value=num_3)
control_points_3 = ControlPoints(Curve=curve_42)  # -> Points, Weights, Knots
unit_z_5 = UnitZ(Factor=negative_4)
nodeload_2 = NodeLoad(point=control_points_3.Points, vector=unit_z_5)  # -> node_load; inputs point: Point3d, vector: Vector3d; same code as nodeload
data_7 = Data(nodeload_2)

# ---- group: Pre-formfound steps
data_8 = Data(data_6)

# ----
number_45 = Number(number_11)
number_46 = Number(number_12)
number_47 = Number(number_13)
curve_43 = Curve(curve_23)
curve_44 = Curve(curve_27)
multiplication_5 = Multiplication(A=number_45, B=number_46)
deviationedge_3 = DeviationEdge(line=curve_44, force=number_47)  # -> deviation_edge; inputs line: Line; same code as deviationedge
deviationedge_4 = DeviationEdge(line=curve_43, force=multiplication_5)  # -> deviation_edge; inputs line: Line; same code as deviationedge
entwine_11 = Entwine(Branch00=deviationedge_4, Branch01=deviationedge_3, Branch02=data_8, FlattenInputs=True)
data_9 = Data(entwine_11)

point_10 = Point(point_8)
nodesupport = NodeSupport(point=point_10)  # -> node_support; inputs point: Point3d
#   port point: The position of the node where to assign a support.
#   port node_support: A COMPAS CEM node support.
# ---------- nodesupport: Python ----------
"""
Create a node support from a point.
"""
from ghpythonlib.componentbase import executingcomponent as component

from compas_rhino.geometry import RhinoPoint
from compas_cem.supports import NodeSupport


class NodeSupportComponent(component):
    def RunScript(self, point):
        if not point:
            return

        xyz = RhinoPoint.from_geometry(point).to_compas()
        return NodeSupport.from_point(xyz)
# ---------- end nodesupport ----------
data_10 = Data(nodesupport)

curve_45 = Curve(curve_40)
number_48 = Number(number_43)
plane_11 = Plane(plane_9)
curve_46 = Curve(curve_41)
plane_12 = Plane(plane_10)
number_49 = Number(number_44)
length_2 = Length(Curve=curve_45)
length_3 = Length(Curve=curve_46)
multiplication_6 = Multiplication(A=length_2, B=number_48)
trailedge = TrailEdge(line=curve_45, length=multiplication_6, plane=plane_11)  # -> trail_edge; inputs line: Line, plane: Plane
#   port line: A line that defines the end nodes of the edge.
#   port length: The signed length of the edge. If negative, the edge is in compression. Otherwise, it is in tension. The length magnitude is ignored if a plane is supplied.
#   port plane: An optional plane to define the length of the trail edge relative to the projection of its start node onto the plane. The force state will be that specified by the length input parameter.
#   port trail_edge: A COMPAS CEM trail edge.
# ---------- trailedge: Python ----------
"""
Create a trail edge from a rhino line.
"""
from ghpythonlib.componentbase import executingcomponent as component

from compas_rhino.geometry import RhinoLine
from compas_rhino.geometry import RhinoPlane

from compas_cem.elements import TrailEdge


class TrailEdgeComponent(component):
    def RunScript(self, line, length, plane):
        if not line or length is None:
            return

        if plane is not None:
            plane = RhinoPlane.from_geometry(plane).to_compas()
        line = RhinoLine.from_geometry(line).to_compas()
        return TrailEdge.from_line(line, length=length, plane=plane)
# ---------- end trailedge ----------

multiplication_7 = Multiplication(A=length_3, B=number_49)

trailedge_2 = TrailEdge(line=curve_46, length=multiplication_7, plane=plane_12)  # -> trail_edge; inputs line: Line, plane: Plane; same code as trailedge
entwine_12 = Entwine(Branch00=trailedge, Branch01=trailedge_2, FlattenInputs=True)
data_11 = Data(entwine_12)

data_12 = Data(data_11)
data_13 = Data(data_9)
data_14 = Data(data_7)
data_15 = Data(data_10)
assembletopologydiagram_2 = AssembleTopologyDiagram(
    trail_edges=flatten(data_12),
    deviation_edges=flatten(data_13),
    loads=flatten(data_14),
    supports=flatten(data_15),
    add_auxiliary_trails=Toggle(True))  # -> topology; inputs trail_edges: list, deviation_edges: list, loads: list, supports: list, add_auxiliary_trails: Boolean
#   port trail_edges: The COMPAS CEM trail edges to add to the diagram.
#   port deviation_edges: The COMPAS CEM deviation edges to add to the diagram.
#   port loads: The COMPAS CEM loads to add to the diagram.
#   port supports: The COMPAS CEM supports to add to the diagram.
#   port add_auxiliary_trails: Append auxiliary trails to the free nodes of the topology diagram. Defaults to False.
#   port topology: A COMPAS CEM topology diagram.
# ---------- assembletopologydiagram_2: Python ----------
"""
Assemble a topology diagram.
"""
from ghpythonlib.componentbase import executingcomponent as component

from compas_cem.diagrams import TopologyDiagram


class AssembleTopologyDiagramComponent(component):
    def RunScript(self, trail_edges, deviation_edges, loads, supports, add_auxiliary_trails):

        add_auxiliary_trails = add_auxiliary_trails or False
        topology = TopologyDiagram()
        topology.auxiliary_trail_vector = [0.0, 0.0, 1.0]
        topology.auxiliary_trail_length = 0.1

        if trail_edges:
            for trail_edge in trail_edges:
                if trail_edge:
                    topology.add_edge(trail_edge)

        if deviation_edges:
            for deviation_edge in deviation_edges:
                if deviation_edge:
                    topology.add_edge(deviation_edge)

        if loads:
            for load in loads:
                if load:
                    topology.add_load(load)

        if supports:
            for support in supports:
                if support:
                    topology.add_support(support)

        if trail_edges and supports:
            topology.build_trails(add_auxiliary_trails)

        elif deviation_edges and add_auxiliary_trails:
            topology.build_trails(add_auxiliary_trails)

        return topology
# ---------- end assembletopologydiagram_2 ----------

formfinding = FormFinding(topology=assembletopologydiagram_2)  # -> form; inputs tmax: Int32
#   port topology: A COMPAS CEM topology diagram.
#   port tmax: The maximum number of iterations to run the form-finding algorithm for. Defaults to 100.
#   port eta: The convergence threshold of the form-finding algorithm. Default to 1e-6.
#   port form: A COMPAS CEM form diagram in static equilibrium.
# ---------- formfinding: Python ----------
"""
Generate a form diagram in static equilibrium.
"""
from ghpythonlib.componentbase import executingcomponent as component

from compas_cem.equilibrium import static_equilibrium


class FormFindingComponent(component):
    def RunScript(self, topology, tmax, eta):
        eta = eta or 1e-6
        tmax = tmax or 100

        if not topology:
            return

        return static_equilibrium(topology, tmax=tmax, eta=eta)
# ---------- end formfinding ----------
data_16 = Data(assembletopologydiagram_2)
data_17 = Data(formfinding)

# ---- group: Helper point constraints
data_18 = Data(flatten(data_16))
number_50 = Number(number_3)
number_51 = Number(number_2)
point_11 = Point(point_8)
negative_5 = Negative(Value=number_50)
negative_6 = Negative(Value=Slider(0.2, range=0..1))
cull_index_3 = CullIndex(List=flatten(point_11), Indices="2", Wrap=True)
addition_6 = Addition(A=negative_5, B=number_51)
vector_xyz = VectorXYZ(XComponent=0, YComponent=addition_6, ZComponent=negative_6)  # -> Vector, Length
list_item_9 = ListItem(List=cull_index_3, Index="2", Wrap=True)
point_12 = Point(cull_index_3)
move_5 = Move(Geometry=list_item_9, Motion=vector_xyz.Vector)  # -> Geometry, Transform
node_search = NodeSearch(diagram=data_18, point=point_12)  # -> node; inputs point: list of Point3d
#   port diagram: A COMPAS CEM topology or form diagram.
#   port point: The points to search for in the diagram.
#   port node: The node keys.
# ---------- node_search: Python ----------
"""
Search a node key in a topology or a form diagram using a point.
"""
from ghpythonlib.componentbase import executingcomponent as component

from compas.utilities import geometric_key
from compas_rhino.geometry import RhinoPoint


class NodeSearchComponent(component):
    def RunScript(self, diagram, point):
        if point and diagram:
            node = []
            for pt in point:
                pt = RhinoPoint.from_geometry(pt).to_compas()
                gkey = geometric_key(pt, diagram.tol)
                node.append(diagram.gkey_node[gkey])
            return node
# ---------- end node_search ----------
replace_items = ReplaceItems(List=cull_index_3, Item=move_5.Geometry, Indices="1", Wrap=False)
point_13 = Point(replace_items)
point_constraint = PointConstraint(node_key=node_search, point=point_13)  # -> constraint; inputs node_key: Int32, point: Point3d
#   port node_key: The key of a COMPAS CEM node.
#   port point: The target point.
#   port weight: The weight of the constraint in the optimization problem. Defaults to one.
#   port constraint: A COMPAS CEM node point constraint.
# ---------- point_constraint: Python ----------
"""
Pull the position of a node to a target point.
"""
from ghpythonlib.componentbase import executingcomponent as component

from compas_cem.optimization import PointConstraint
from compas_rhino.geometry import RhinoPoint


class PointConstraintComponent(component):
    def RunScript(self, node_key, point, weight):
        weight = weight or 1.0
        if node_key is not None and point:
            point = RhinoPoint.from_geometry(point).to_compas()
            return PointConstraint(node_key, point, weight)
# ---------- end point_constraint ----------
data_19 = Data(point_constraint)

# ---- group: Edge force constraint
curve_47 = Curve(curve_22)
data_20 = Data(flatten(data_16))
list_item_10 = ListItem(List=curve_47, Index="-1", Wrap=True)  # -> flatten(Item)
list_item_11 = ListItem(List=list_item_10, Index=0, Wrap=True)  # -> Item, Item1
curve_48 = Curve(list_item_11.Item1)
edge_search = EdgeSearch(diagram=data_20, line=curve_48)  # -> edge; inputs line: list of Line
#   port diagram: A COMPAS CEM topology or form diagram.
#   port line: The lines to search for in the diagram.
#   port edge: The edge keys.
# ---------- edge_search: Python ----------
"""
Search a node key in a topology or a form diagram using a point.
"""
from ghpythonlib.componentbase import executingcomponent as component

from compas.utilities import geometric_key
from compas_rhino.geometry import RhinoLine


class EdgeSearchComponent(component):
    def RunScript(self, diagram, line):
        if diagram and line:

            edge = []
            for ln in line:
                ln = RhinoLine.from_geometry(ln).to_compas()

                eg = []
                for point in (ln.start, ln.end):
                    gkey = geometric_key(point, diagram.tol)
                    node = diagram.gkey_node[gkey]
                    eg.append(node)
                edge.append(tuple(eg))

            return edge
# ---------- end edge_search ----------
trail_edge_force_constraint = TrailEdgeForceConstraint(edge_key=edge_search, force="35")  # -> constraint
#   port edge_key: The key of a COMPAS CEM trail edge.
#   port force: The target force.
#   port weight: The weight of the constraint in the optimization problem. Defaults to one.
#   port constraint: A COMPAS CEM trail force constraint.
# ---------- trail_edge_force_constraint: Python ----------
"""
Make the force on a trail edge to reach a goal force value.
"""
from ghpythonlib.componentbase import executingcomponent as component

from compas_cem.optimization import TrailEdgeForceConstraint


class TrailEdgeForceConstraintComponent(component):
    def RunScript(self, edge_key, force, weight):
        weight = weight or 1.0
        if edge_key and force is not None:
            return TrailEdgeForceConstraint(edge_key, force, weight)
# ---------- end trail_edge_force_constraint ----------
data_21 = Data(trail_edge_force_constraint)

# ---- group: Auxiliary trails constraint
data_22 = Data(flatten(data_16))
topologydisassembly_3 = DisassembleTopologyDiagram(topology=data_22)  # -> node_keys, origin_node_keys, support_node_keys, edge_keys, trail_edge_keys, deviation_edge_keys, trail_keys, auxiliary_trail_keys; same code as topologydisassembly
trailedgeforceconstraint_2 = TrailEdgeForceConstraint(edge_key=topologydisassembly_3.auxiliary_trail_keys, force="0.0")  # -> constraint; same code as trail_edge_force_constraint
data_23 = Data(trailedgeforceconstraint_2)

# ---- group: Parameters
data_24 = Data(flatten(data_16))
# 3. Solve global constrained form-finding problem in sequential stages to improve convergence
data_25 = Data(data_16)
curve_49 = Curve(curve_33)
disassemble_topology_diagram = DisassembleTopologyDiagram(topology=data_24)  # -> nodes, origin_nodes, support_nodes, edges, trail_edges, deviation_edges, trails, auxiliary_trails; same code as topologydisassembly
edge_search_2 = EdgeSearch(diagram=data_24, line=curve_49)  # -> flatten(edge); inputs line: list of Line; same code as edge_search
ghpython_script = GhPythonScript(x=disassemble_topology_diagram.deviation_edges, y=edge_search_2)  # -> out, a; inputs x: list, y: list
# ---------- ghpython_script: Python ----------
a = []


y = set(y)

for key in x:
    if key in y:
        continue
    a.append(key)
# ---------- end ghpython_script ----------
data_26 = Data(ghpython_script.a)
curve_50 = Curve(curve_23)
data_27 = Data(data_25)
control_points_4 = ControlPoints(Curve=curve_50)  # -> Points, Weights, Knots
data_28 = Data(data_25)
number_slider_5 = Slider(0.2, range=0..1)
data_29 = Data(data_26)
nodesearch = NodeSearch(diagram=data_27, point=simplify(control_points_4.Points))  # -> node; inputs point: list of Point3d; same code as node_search
ghpython_script_2 = GhPythonScript(topology=data_28, edges=data_29, bound="100")  # -> out, edge_key, bound_low, bound_up; inputs edges: list
# ---------- ghpython_script_2: Python ----------
from math import fabs


edge_key = []
bound_low = []
bound_up = []

edges = edges or list(topology.deviation_edges())

for edge in edges:
    force = topology.edge_force(edge)
   
    if force <= 0.0:
        bup = 0.0
        blow = fabs(bound)
    else:
        bup = fabs(bound)
        blow = 0.0
        
    edge_key.append(edge)
    bound_low.append(blow)
    bound_up.append(bup)
# ---------- end ghpython_script_2 ----------
deviationedgeforceparameter_2 = DeviationEdgeForceParameter(edge_key=ghpython_script_2.edge_key, bound_low=ghpython_script_2.bound_low, bound_up=ghpython_script_2.bound_up)  # -> parameter
#   port edge_key: The key of a COMPAS CEM deviation edge.
#   port bound_low: The lower bound of the edge optimization parameter. Calculated as the initial edge parameter minus the absolute value of this bound.
#   port bound_up: The upper bound of the edge optimization parameter. Calculated as the initial edge parameter plus the absolute value of this bound.
#   port parameter: A COMPAS CEM deviation edge force parameter.
# ---------- deviationedgeforceparameter_2: Python ----------
"""
Set the force of a deviation edge as an optimization parameter.
"""
from ghpythonlib.componentbase import executingcomponent as component

from compas_cem.optimization import DeviationEdgeParameter


class DeviationEdgeParameterComponent(component):
    def RunScript(self, edge_key, bound_low, bound_up):
        if edge_key and bound_low is not None and bound_up is not None:
            return DeviationEdgeParameter(edge_key, bound_low, bound_up)
# ---------- end deviationedgeforceparameter_2 ----------
originnodezparameter = OriginNodeZParameter(node_key=nodesearch, bound_low=number_slider_5, bound_up=number_slider_5)  # -> parameter; inputs node_key: Int32
#   port node_key: The key of a COMPAS CEM origin node.
#   port bound_low: The lower bound of the node optimization parameter. Calculated as the initial node parameter minus the absolute value of this bound.
#   port bound_up: The upper bound of the node optimization parameter. Calculated as the initial node parameter plus the absolute value of this bound.
#   port parameter: A COMPAS CEM origin node Z parameter.
# ---------- originnodezparameter: Python ----------
"""
Set the Z coordinate of an origin node as an optimization parameter.
"""
from ghpythonlib.componentbase import executingcomponent as component

from compas_cem.optimization import OriginNodeZParameter


class OriginNodeZParameterComponent(component):
    def RunScript(self, node_key, bound_low, bound_up):
        if node_key is not None and bound_low is not None and bound_up is not None:
            return OriginNodeZParameter(node_key, bound_low, bound_up)
# ---------- end originnodezparameter ----------
entwine_13 = Entwine(Branch00=deviationedgeforceparameter_2, Branch01=originnodezparameter, FlattenInputs=True)
data_30 = Data(entwine_13)

# ---- group: topology
data_31 = Data(data_16)

# ---- group: display topology diagram
data_32 = Data(data_31)
number_52 = Number(number_20)
number_53 = Number(number_17)
number_54 = Number(number_18)
cluster = Cluster(data=data_32, num=number_52, num_3=number_53, num_2=number_54)  # -> int_2, pt_2, data_4, crv_10, crv_6, crv_7, crv_8, crv_9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
data_33 = Data(cluster.data_4)
integer_7 = Integer(cluster.int_2)
point_14 = Point(cluster.pt_2)
curve_51 = Curve(cluster.crv_6)
curve_52 = Curve(cluster.crv_7)
curve_53 = Curve(cluster.crv_8)
brep = Brep(cluster.brep_2)
number_55 = Number(cluster.num_9)
number_56 = Number(cluster.num_10)
colour = Colour(cluster.col_7)
colour_2 = Colour(cluster.col_6)
colour_3 = Colour(cluster.col_10)
curve_54 = Curve(cluster.crv_9)
colour_4 = Colour(cluster.col_8)
colour_5 = Colour(cluster.col_9)
curve_55 = Curve(cluster.crv_10)

curve_56 = Curve(curve_54)
colour_6 = Colour(colour_3)
end_points_4 = EndPoints(Curve=curve_56)  # -> Start, End
vector_2pt = Vector2Pt(PointA=end_points_4.Start, PointB=end_points_4.End, Unitize=False)  # -> Vector, Length
reverse_3 = Reverse(Vector=vector_2pt.Vector)
move_6 = Move(Geometry=end_points_4.Start, Motion=reverse_3)  # -> Geometry, Transform

data_34 = Data(data_33)
point_15 = Point(point_14)
curve_57 = Curve(curve_55)
integer_8 = Integer(integer_7)
colour_swatch = ColourSwatch(SwatchColor=RGBA(156, 156, 156, 195))
curve_middle = CurveMiddle(Curve=curve_57)

curve_58 = Curve(curve_51)
number_57 = Number(number_55)
curve_59 = Curve(curve_53)
number_58 = Number(number_56)
colour_swatch_2 = ColourSwatch(SwatchColor=RGB(184, 184, 184))
curve_middle_2 = CurveMiddle(Curve=curve_58)
curve_middle_3 = CurveMiddle(Curve=curve_59)

curve_60 = Curve(curve_53)
curve_61 = Curve(curve_51)
colour_7 = Colour(colour)
curve_62 = Curve(curve_53)
colour_8 = Colour(colour_4)
number_59 = Number(number_19)
colour_9 = Colour(colour_2)
dash_pattern = DashPattern(Curve=curve_60, Pattern=number_59)  # -> Dashes, Gaps
custom_preview = CustomPreview(Geometry=dash_pattern.Dashes, Material=colour_9)  # disabled

brep_2 = Brep(brep)
colour_10 = Colour(colour_5)

# ---- group: display topology diagram / Trail edges
custom_preview_2 = CustomPreview(Geometry=curve_61, Material=colour_7)

# ---- group: display topology diagram / Deviation edges
custom_preview_3 = CustomPreview(Geometry=curve_62, Material=colour_8)

# ---- group: display topology diagram / Nodes
custom_preview_4 = CustomPreview(Geometry=brep_2, Material=colour_10)  # disabled

# ---- group: display topology diagram / Node keys
text_tag = TextTag(Location=point_15, Text=integer_8, Colour=colour_swatch)

# ---- group: display topology diagram / Edge keys
text_tag_2 = TextTag(Location=curve_middle, Text=data_34, Colour=colour_swatch)

# ---- group: display topology diagram / Trail lengths
text_tag_3 = TextTag(Location=curve_middle_2, Text=number_57, Colour=colour_swatch_2)

# ---- group: display topology diagram / Deviation forces
text_tag_4 = TextTag(Location=curve_middle_3, Text=number_58, Colour=colour_swatch_2)

# ---- group: display topology diagram / Loads
vector_display_ex = VectorDisplayEx(Point=move_6.Geometry, Vector=vector_2pt.Vector, Colour=colour_6, Width=2)

# ----
point_16 = Point(point_13)
point_17 = Point(point_8)
data_35 = Data(flatten(data_16))
list_item_12 = ListItem(List=point_17, Index="-1", Wrap=True)  # -> flatten(Item)
cull_index_4 = CullIndex(List=point_16, Indices="0", Wrap=True)
list_item_13 = ListItem(List=list_item_12, Index=0, Wrap=True)  # -> Item1, Item
list_item_14 = ListItem(List=cull_index_4, Index=0, Wrap=True)  # -> Item1, Item
unit_y = UnitY(Factor=1)
rev = Reverse(Vector=unit_y)
division_3 = Division(A="5", B=2)
multiplication_8 = Multiplication(A=unit_y, B=division_3)

point_18 = Point(list_item_13.Item1)
point_19 = Point(list_item_14.Item1)

point_20 = Point(list_item_13.Item)
point_21 = Point(list_item_14.Item)

panel_9 = Panel(point_18)
move_7 = Move(Geometry=point_21, Motion=multiplication_8)  # -> Geometry, Transform

# ---- group: Point constraint
node_search_2 = NodeSearch(diagram=data_35, point=point_18)  # -> node; inputs point: list of Point3d; same code as node_search
point_constraint_2 = PointConstraint(node_key=node_search_2, point=point_18)  # -> constraint; inputs node_key: Int32, point: Point3d; same code as point_constraint
data_36 = Data(point_constraint_2)

# ---- group: Line constraint
node_search_3 = NodeSearch(diagram=data_35, point=point_20)  # -> node; inputs point: list of Point3d; same code as node_search
line_sdl = LineSDL(Start=move_7.Geometry, Direction=rev, Length="5")
line_constraint = LineConstraint(node_key=node_search_3, line=line_sdl)  # -> constraint; inputs node_key: Int32, line: Line
#   port node_key: The key of a COMPAS CEM node.
#   port line: The target line ray.
#   port weight: The weight of the constraint in the optimization problem. The weight of the constraint in the optimization problem. Defaults to one
#   port constraint: A COMPAS CEM line constraint.
# ---------- line_constraint: Python ----------
"""
Pull the position of a node to a target line ray.
"""
from ghpythonlib.componentbase import executingcomponent as component

from compas_cem.optimization import LineConstraint
from compas_rhino.geometry import RhinoLine


class LineConstraintComponent(component):
    def RunScript(self, node_key, line, weight):
        weight = weight or 1.0
        if node_key is not None and line:
            line = RhinoLine.from_geometry(line).to_compas()
            return LineConstraint(node_key, line, weight)
# ---------- end line_constraint ----------
data_37 = Data(line_constraint)

# ----
data_38 = Data(data_16)
data_39 = Data(flatten(data_19))
data_40 = Data(data_30)
text_2 = Text(text)
integer_9 = Integer(integer)
constrainedformfinding_2 = ConstrainedFormFinding(
    solve=Toggle(True),
    topology=data_38,
    constraints=flatten(data_39),
    parameters=flatten(data_40),
    algorithm=text_2,
    iters_max=integer_9)  # -> topology, form, objective, grad_norm, iters, time, status; inputs solve: Boolean, constraints: list, parameters: list, iters_max: Int32, tmax: Int32; same code as constrainedformfinding
panel_10 = Panel(constrainedformfinding_2.status)
panel_11 = Panel(constrainedformfinding_2.grad_norm)
panel_12 = Panel(constrainedformfinding_2.time)
panel_13 = Panel(constrainedformfinding_2.iters)
panel_14 = Panel(constrainedformfinding_2.objective)
data_41 = Data(constrainedformfinding_2.form)
data_42 = Data(constrainedformfinding_2.topology)
data_43 = Data(flatten([data_19, data_23]))
integer_10 = Integer(integer)
data_44 = Data(data_42)
text_3 = Text(text)
data_45 = Data(data_30)
constrainedformfinding_3 = ConstrainedFormFinding(
    solve=Toggle(True),
    topology=data_44,
    constraints=flatten(data_43),
    parameters=flatten(data_45),
    algorithm=text_3,
    iters_max=integer_10)  # -> topology, form, objective, grad_norm, iters, time, status; inputs solve: Boolean, constraints: list, parameters: list, iters_max: Int32, tmax: Int32; same code as constrainedformfinding
data_46 = Data(constrainedformfinding_3.topology)
data_47 = Data(constrainedformfinding_3.form)
panel_15 = Panel(constrainedformfinding_3.objective)
panel_16 = Panel(constrainedformfinding_3.grad_norm)
panel_17 = Panel(constrainedformfinding_3.iters)
panel_18 = Panel(constrainedformfinding_3.time)
panel_19 = Panel(constrainedformfinding_3.status)
data_48 = Data(flatten([data_23, data_21, data_36, data_37]))
data_49 = Data(flatten(data_30))
text_4 = Text(text)
integer_11 = Integer(integer)

# ---- group: replace planes on edges close to the floor plane
curve_63 = Curve(curve_19)
data_50 = Data(data_46)
explode_9 = Explode(Curve=curve_63, Recursive=True)  # -> Segments, Vertices
item_2 = ListItem(List=explode_9.Segments, Index=0, Wrap=True)
flip = FlipCurve(Curve=item_2)  # -> Curve, Flag
searchedgekey = SearchEdgeKey(diagram=data_50, line=flip.Curve)  # -> flatten(edge_key); inputs line: Line
#   port diagram: A COMPAS CEM topology or form diagram.
#   port line: The line to search for in the diagram.
#   port edge_key: The edge key in the diagram.
# ---------- searchedgekey: Python ----------
"""
Search for an edge key in a topology or a form diagram using a line.
"""
from ghpythonlib.componentbase import executingcomponent as component

from compas_rhino.geometry import RhinoLine
from compas.utilities import geometric_key


class SearchEdgeKeyComponent(component):
    def RunScript(self, diagram, line):
        if not (diagram and line):
            return

        line = RhinoLine.from_geometry(line).to_compas()

        eg = []
        for point in (line.start, line.end):
            gkey = geometric_key(point, diagram.tol)
            node = diagram.gkey_node[gkey]
            eg.append(node)

        return [tuple(eg)]
# ---------- end searchedgekey ----------
xy = XYPlane(Origin=Point(0, 0, 0))
python_2 = GhPythonScript(topology=data_50, edge_keys=searchedgekey, plane=xy)  # -> out, topology; inputs edge_keys: list, plane: Plane
# ---------- python_2: Python ----------
from compas_rhino.geometry import RhinoPlane


if topology:
    topology = topology.copy()

    plane = RhinoPlane.from_geometry(plane).to_compas()
    for edge in edge_keys:
        if not topology.is_trail_edge(edge):
            raise ValueError("Edge {} is not a trail edge!".format(edge))
        topology.edge_attribute(edge, "plane", plane)
# ---------- end python_2 ----------
data_51 = Data(python_2.topology)

# ----
data_52 = Data(data_51)
constrainedformfinding_4 = ConstrainedFormFinding(solve=Toggle(True), topology=data_52, constraints=data_48, parameters=data_49, algorithm=text_4, iters_max=integer_11)  # -> topology, form, objective, grad_norm, iters, time, status; inputs solve: Boolean, constraints: list, parameters: list, iters_max: Int32, tmax: Int32; same code as constrainedformfinding
data_53 = Data(constrainedformfinding_4.form)
panel_20 = Panel(constrainedformfinding_4.status)
panel_21 = Panel(constrainedformfinding_4.objective)
panel_22 = Panel(constrainedformfinding_4.grad_norm)
panel_23 = Panel(constrainedformfinding_4.time)
panel_24 = Panel(constrainedformfinding_4.iters)

data_54 = Data(data_17)
data_55 = Data(data_47)
data_56 = Data(data_41)
data_57 = Data(data_53)
stream_filter = StreamFilter(Gate=Slider(3, range=0..3), Stream0=data_54, Stream1=data_56, Stream2=data_55, Stream3=data_57)
data_58 = Data(stream_filter)

# ---- group: form
data_59 = Data(data_58)

# ---- group: display form diagram
number_60 = Number(number_15)
data_60 = Data(data_59)
number_61 = Number(number_16)
number_62 = Number(number_14)
integer_12 = Integer(integer_2)

data_61 = Data(data_60)
number_63 = Number(number_61)
number_64 = Number(number_60)
integer_13 = Integer(integer_12)
number_65 = Number(number_62)
form_artist = FormArtist(form=data_61)  # -> nodes, support_nodes, edges, loads, reactions; inputs node: list of Int32, edge: list
#   port form: A COMPAS CEM topology diagram.
#   port node: A selection of the nodes in the diagram. Defaults to all the nodes.
#   port edge: A selection of the edges in the diagram. Defaults to all the edges.
#   port force_min: The smallest force magnitude to draw. Defaults to 1e-3
#   port force_scale: The scale of the loads and the reactions. Defaults to 1.
#   port nodes: The nodes of the diagram as points.
#   port support_nodes: The support nodes of the diagram as points
#   port edges: The edges of the diagram as lines.
#   port loads: The applied loads as lines.
#   port reactions: The reaction forces at the supports, as lines.
# ---------- form_artist: Python ----------
"""
Draw a form diagram.
"""
from ghpythonlib.componentbase import executingcomponent as component

from compas_cem.ghpython import FormArtist


class FormArtistComponent(component):
    def RunScript(self, form, node, edge, force_min, force_scale):
        node = node or None
        edge = edge or None
        force_min = force_min or 1e-3
        force_scale = force_scale or 1
        if form:
            artist = FormArtist(form)

            nodes = artist.draw_nodes(node)
            edges = artist.draw_edges(edge)
            support_nodes = artist.draw_nodes_support(node)

            loads = artist.draw_loads(node, min_load=force_min, scale=force_scale)
            reactions = artist.draw_reactions(node, min_force=force_min, scale=force_scale)

            return nodes, support_nodes, edges, loads, reactions
# ---------- end form_artist ----------
edgeresults = EdgeResults(form=data_61)  # -> length, force; inputs edge: list; same code as edgeresults
formartist = FormArtist(form=data_61, force_min=number_63, force_scale=number_64, load_scale=load_scale)  # -> nodes, support_nodes, edges, loads, reactions; inputs node: list of Int32, edge: list
#   port form: A COMPAS CEM topology diagram.
#   port node: A selection of the nodes in the diagram. Defaults to all the nodes.
#   port edge: A selection of the edges in the diagram. Defaults to all the edges.
#   port force_min: The smallest force magnitude to draw. Defaults to 1e-3
#   port force_scale: The scale of the loads and the reactions. Defaults to 1.
#   port nodes: The nodes of the diagram as points.
#   port support_nodes: The support nodes of the diagram as points
#   port edges: The edges of the diagram as lines.
#   port loads: The applied loads as lines.
#   port reactions: The reaction forces at the supports, as lines.
# ---------- formartist: Python ----------
"""
Draw a form diagram.
"""
from ghpythonlib.componentbase import executingcomponent as component

from compas_cem.ghpython import FormArtist


class FormArtistComponent(component):
    def RunScript(self, form, node, edge, force_min, force_scale, load_scale):
        force_min = force_min or 1e-3
        force_scale = force_scale or 1
        if form:
            artist = FormArtist(form)

            nodes = artist.draw_nodes(node)
            edges = artist.draw_edges(edge)
            support_nodes = artist.draw_nodes_support(node)

            loads = artist.draw_loads(node, min_load=force_min, scale=load_scale)
            reactions = artist.draw_reactions(node, min_force=force_min, scale=force_scale)

            return nodes, support_nodes, edges, loads, reactions
# ---------- end formartist ----------
cem_colors = CEMColors()  # -> color_tension, color_compression, color_edge, color_node, color_node_support, color_node_origin, color_load, color_reaction, color_trail, color_auxiliary_trail; same code as cem_colors
edgeresults_2 = EdgeResults(form=data_61)  # -> length, force; inputs edge: list; same code as edgeresults
formdisassembly = DisassembleFormDiagram(form=data_61)  # -> nodes, support_nodes, edges
#   port form: A COMPAS CEM form diagram.
#   port nodes: All the node keys in the form diagram.
#   port support_nodes: The keys of the support nodes in the form diagram.
#   port edges: All the edge keys in the form diagram.
# ---------- formdisassembly: Python ----------
"""
Disassemble a form diagram into its constituent parts.
"""
from ghpythonlib.componentbase import executingcomponent as component


class FormDisassemblyComponent(component):
    def RunScript(self, form):
        if form:
            edges = list(form.edges())
            nodes = list(form.nodes())
            support_nodes = list(form.support_nodes())

            return nodes, support_nodes, edges
# ---------- end formdisassembly ----------
larger_than = LargerThan(FirstNumber=edgeresults_2.force, SecondNumber=0)  # -> LargerThan, OrEqualTo
absolute_2 = Absolute(Value=edgeresults_2.force)
colour_swatch_3 = ColourSwatch(SwatchColor=RGB(0, 35, 84))
colour_swatch_4 = ColourSwatch(SwatchColor=RGB(186, 0, 0))
stream_filter_2 = StreamFilter(Gate=integer_13, Stream0=edgeresults.force, Stream1=edgeresults.length)
stream_filter_3 = StreamFilter(Gate=integer_13, Stream0=edgeresults_2.force, Stream1=edgeresults_2.length)
merge_3 = Merge(Data1=cem_colors.color_compression, Data2=cem_colors.color_tension)
ghpython_script_3 = GhPythonScript(x=stream_filter_2)  # -> out, a
# ---------- ghpython_script_3: Python ----------
a = round(x, 3)
# ---------- end ghpython_script_3 ----------
multiplication_9 = Multiplication(A=absolute_2, B=number_65)
ghpython_script_4 = GhPythonScript(x=stream_filter_3)  # -> out, a; same code as ghpython_script_3
list_item_15 = ListItem(List=merge_3, Index=larger_than.OrEqualTo, Wrap=True)
number_66 = Number(absolute_2)
number_67 = Number(multiplication_9)
number_68 = Number(ghpython_script_4.a)
colour_11 = Colour(cem_colors.color_load)
colour_12 = Colour(list_item_15)
integer_14 = Integer(formdisassembly.nodes)
data_62 = Data(formdisassembly.edges)
point_22 = Point(formartist.nodes)
curve_64 = Curve(formartist.edges)
curve_65 = Curve(formartist.loads)
curve_66 = Curve(formartist.reactions)
colour_13 = Colour(colour_11)
colour_14 = Colour(colour_12)
number_69 = Number(number_67)
data_63 = Data(data_62)
point_23 = Point(point_22)
curve_67 = Curve(curve_64)
number_70 = Number(number_68)
curve_68 = Curve(form_artist.edges)
number_71 = Number(ghpython_script_3.a)
integer_15 = Integer(integer_14)

# ----
colour_15 = Colour(colour_14)
curve_69 = Curve(curve_64)
number_72 = Number(number_70)
absolute_3 = Absolute(Value=number_72)
multiplication_10 = Multiplication(A=absolute_3, B="0.1")

curve_70 = Curve(curve_65)
curve_71 = Curve(curve_66)
colour_16 = Colour(colour_13)
end_points_5 = EndPoints(Curve=curve_70)  # -> Start, End
end_points_6 = EndPoints(Curve=curve_71)  # -> Start, End
vector_2pt_2 = Vector2Pt(PointA=end_points_6.Start, PointB=end_points_6.End, Unitize=False)  # -> Vector, Length
vector_2pt_3 = Vector2Pt(PointA=end_points_5.Start, PointB=end_points_5.End, Unitize=False)  # -> Vector, Length

number_73 = Number(number_71)
curve_72 = Curve(curve_68)
curve_middle_4 = CurveMiddle(Curve=curve_72)

curve_middle_5 = CurveMiddle(Curve=curve_67)
colour_swatch_5 = ColourSwatch(SwatchColor=RGBA(0, 0, 0, 195))

# ---- group: Edges
custom_preview_lineweights = CustomPreviewLineweights(Geometry=curve_69, Shader=colour_15, Thickness=multiplication_10, Absolute=False)

# ---- group: Edge results
text_tag_5 = TextTag(Location=curve_middle_4, Text=number_73, Colour=ColourSwatch(SwatchColor=RGBA(94, 94, 94, 195)))

# ---- group: Edge keys
text_tag_6 = TextTag(Location=curve_middle_5, Text=data_63, Colour=colour_swatch_5)

# ---- group: Node keys
text_tag_7 = TextTag(Location=point_23, Text=integer_15, Colour=colour_swatch_5)

# ---- group: Loads
vector_display_ex_2 = VectorDisplayEx(Point=end_points_5.Start, Vector=vector_2pt_3.Vector, Colour=colour_16, Width=2)

# ---- group: Reaction forces
vector_display_ex_3 = VectorDisplayEx(Point=end_points_6.Start, Vector=vector_2pt_2.Vector, Colour=ColourSwatch(SwatchColor=RGB(84, 255, 124)), Width=2)

# ==== cluster Cluster
num = ClusterInput()
num_2 = ClusterInput()
num_3 = ClusterInput()
data = ClusterInput()
num_4 = Number(num)
num_5 = Number(num_2)
num_6 = Number(num_3)
data_2 = Data(data)
topologyartist = TopologyArtist(topology=data_2)  # -> nodes, origin_nodes, support_nodes, edges, trail_edges, deviation_edges, loads; inputs node: list of Int32, edge: list
#   port topology: A COMPAS CEM topology diagram.
#   port node: A selection of the nodes in the diagram. Defaults to all the nodes.
#   port edge: A selection of the edges in the diagram. Defaults to all the edges.
#   port load_min: The minimum load magnitude to plot. Defaults to 1e-3.
#   port load_scale: The scaling factor of the loads. Defaults to 1.
#   port nodes: The nodes in the diagram as points.
#   port origin_nodes: The origin nodes in the diagram as points.
#   port support_nodes: The position of the support nodes in the diagram.
#   port edges: The edges in the diagram as lines.
#   port trail_edges: The trail edges in the diagram as lines.
#   port deviation_edges: The deviation edges in the diagram as lines.
#   port loads: The applied node loads as lines.
# ---------- topologyartist: Python ----------
"""
Draw a topology diagram.
"""
from ghpythonlib.componentbase import executingcomponent as component

from compas_cem.ghpython import TopologyArtist


class TopologyArtistComponent(component):
    def RunScript(self, topology, node, edge, load_min, load_scale):
        node = node or None
        edge = edge or None
        load_min = load_min or 1e-3
        load_scale = load_scale or 1.0
        if topology:
            artist = TopologyArtist(topology)

            nodes = artist.draw_nodes(node)
            origin_nodes = artist.draw_nodes_origin(node)
            support_nodes = artist.draw_nodes_support(node)

            edges = artist.draw_edges(edge)
            trail_edges = artist.draw_edges_trail(edge)
            deviation_edges = artist.draw_edges_deviation(edge)

            loads = artist.draw_loads(node, min_load=load_min, scale=load_scale)

            return nodes, origin_nodes, support_nodes, edges, trail_edges, deviation_edges, loads
# ---------- end topologyartist ----------
topologydisassembly = DisassembleTopologyDiagram(topology=data_2)  # -> nodes, origin_nodes, support_nodes, edges, trail_edges, deviation_edges, trails, auxiliary_trails
#   port topology: A COMPAS CEM topology diagram.
#   port nodes: All the node keys in the topology diagram.
#   port origin_nodes: The keys of the origin nodes in the topology diagram.
#   port support_nodes: The keys of the support nodes in the topology diagram.
#   port edges: All the edge keys in the topology diagram.
#   port trail_edges: The keys of the trail edges in the topology diagram.
#   port deviation_edges: The keys of the deviation edges in the topology diagram.
#   port trails: The trails in the topology diagram.
#   port auxiliary_trails: The auxiliary trails in the topology diagram.
# ---------- topologydisassembly: Python ----------
"""
Disassemble a topology diagram into its constituent parts.
"""
from ghpythonlib.componentbase import executingcomponent as component


class TopologyDisassemblyComponent(component):
    def RunScript(self, topology):
        if topology:
            trails = list(topology.trails())
            auxiliary_trails = list(topology.auxiliary_trails())

            edges = list(topology.edges())
            trail_edges = list(topology.trail_edges())
            deviation_edges = list(topology.deviation_edges())

            nodes = list(topology.nodes())
            origin_nodes = list(topology.origin_nodes())
            support_nodes = list(topology.support_nodes())

            return nodes, origin_nodes, support_nodes, edges, trail_edges, deviation_edges, trails, auxiliary_trails
# ---------- end topologydisassembly ----------
cem_colors = CEMColors()  # -> color_tension, color_compression, color_edge, color_node, color_node_support, color_node_origin, color_load, color_reaction, color_trail, color_auxiliary_trail
#   port color_tension: The color for edges under a tension force.
#   port color_compression: The color for edges under a compression force.
#   port color_edge: The color for a regular edge.
#   port color_node: The color for a regular node.
#   port color_node_support: The color for a support node.
#   port color_node_origin: The color for an origin node.
#   port color_load: The color for an applied load.
#   port color_reaction: The color for a reaction force.
#   port color_trail: The color to paint a trail.
#   port color_auxiliary_trail: The color to paint an auxiliary trail.
# ---------- cem_colors: Python ----------
"""
Get the artists color scheme for the objects of the CEM framework.
"""
from ghpythonlib.componentbase import executingcomponent as component

from compas_cem import COLORS
import rhinoscriptsyntax as rs


class ArtistColorsComponent(component):
    def RunScript(self):
        colors = {key: rs.CreateColor(c) for key, c in COLORS.items()}

        color_tension = colors["tension"]
        color_compression = colors["compression"]
        color_edge = colors["edge"]
        color_node = colors["node"]
        color_node_support = colors["node_support"]
        color_node_origin = colors["node_origin"]
        color_load = colors["load"]
        color_reaction = colors["support_force"]
        color_trail = colors["trail"]
        color_auxiliary_trail = colors["auxiliary_trail"]

        colors = (color_tension, color_compression, color_edge, color_node, color_node_support, color_node_origin, color_load, color_reaction, color_trail, color_auxiliary_trail)

        return colors
# ---------- end cem_colors ----------
python = GhPythonScript(topology=data_2, auxiliary_trail=topologydisassembly.auxiliary_trails)  # -> out, auxiliary_trail; inputs auxiliary_trail: list
# ---------- python: Python ----------
from compas_cem.ghpython import TopologyArtist


if auxiliary_trail is not None:
    artist = TopologyArtist(topology)
   
    if auxiliary_trail is not None:
        auxiliary_trail = artist.draw_edges_trail(auxiliary_trail)
# ---------- end python ----------
python_2 = GhPythonScript(trail=topologydisassembly.trail_edges, auxiliary_trail=topologydisassembly.auxiliary_trails)  # -> out, trail; inputs trail: list, auxiliary_trail: list
# ---------- python_2: Python ----------
trail = [tr for tr in trail if tr not in auxiliary_trail]
# ---------- end python_2 ----------
topologyartist_2 = TopologyArtist(topology=data_2, edge=python_2.trail, load_min=num_5, load_scale=num_6)  # -> nodes, origin_nodes, support_nodes, edges, trail_edges, deviation_edges, loads; inputs node: list of Int32, edge: list
#   port topology: A COMPAS CEM topology diagram.
#   port node: A selection of the nodes in the diagram. Defaults to all the nodes.
#   port edge: A selection of the edges in the diagram. Defaults to all the edges.
#   port load_min: The minimum load magnitude to plot. Defaults to 1e-3.
#   port load_scale: The scaling factor of the loads. Defaults to 1.
#   port nodes: The nodes in the diagram as points.
#   port origin_nodes: The origin nodes in the diagram as points.
#   port support_nodes: The position of the support nodes in the diagram.
#   port edges: The edges in the diagram as lines.
#   port trail_edges: The trail edges in the diagram as lines.
#   port deviation_edges: The deviation edges in the diagram as lines.
#   port loads: The applied node loads as lines.
# ---------- topologyartist_2: Python ----------
"""
Draw a topology diagram.
"""
from ghpythonlib.componentbase import executingcomponent as component

from compas_cem.ghpython import TopologyArtist


class TopologyArtistComponent(component):
    def RunScript(self, topology, node, edge, load_min, load_scale):
        node = node or None
        edge = edge or None
        load_min = load_min or 1e-3
        load_scale = load_scale or 1.0
        if topology:
            artist = TopologyArtist(topology)

            nodes = artist.draw_nodes(node)
            origin_nodes = artist.draw_nodes_origin(node)
            support_nodes = artist.draw_nodes_support(node)

            edges = artist.draw_edges(edge)
            trail_edges = artist.draw_edges_trail(node)
            deviation_edges = artist.draw_edges_deviation(node)

            loads = artist.draw_loads(node, min_load=load_min, scale=load_scale)

            return nodes, origin_nodes, support_nodes, edges, trail_edges, deviation_edges, loads
# ---------- end topologyartist_2 ----------
entwine = Entwine(Branch00=topologyartist_2.origin_nodes, Branch01=topologyartist_2.support_nodes, FlattenInputs=True)
entwine_2 = Entwine(Branch00=cem_colors.color_node_origin, Branch01=cem_colors.color_node_support, FlattenInputs=True)
merge = Merge(Data1=cem_colors.color_compression, Data2=cem_colors.color_tension)
edgeresults = EdgeResults(form=data_2, edge=python_2.trail)  # -> length, force; inputs edge: list
#   port form: A COMPAS CEM form diagram.
#   port edge: A selection of edge keys to query the results on. Defaults to all the edges.
#   port length: The edge lengths.
#   port force: The edge forces.
# ---------- edgeresults: Python ----------
"""
Extract the post form-finding results of the edges in a form diagram.
"""
from ghpythonlib.componentbase import executingcomponent as component


class EdgeResultsComponent(component):
    def RunScript(self, form, edge):
        if form:
            edge = edge or list(form.edges())
            length = [form.edge_length_2(ed) for ed in edge]
            force = [form.edge_force(ed) for ed in edge]
            return length, force
# ---------- end edgeresults ----------
edgeresults_2 = EdgeResults(form=data_2, edge=topologydisassembly.deviation_edges)  # -> length, force; inputs edge: list; same code as edgeresults
larger = LargerThan(FirstNumber=edgeresults_2.force, SecondNumber=0)  # -> LargerThan, OrEqualTo
larger_2 = LargerThan(FirstNumber=edgeresults.length, SecondNumber=0)  # -> LargerThan, OrEqualTo
sph = Sphere(Base=entwine, Radius=num_4)
item = ListItem(List=merge, Index=larger.OrEqualTo, Wrap=True)
graft = GraftTree(Tree=item, IncludeEmptyLists=True, IncludeNullItems=True)
item_2 = ListItem(List=merge, Index=larger_2.OrEqualTo, Wrap=True)
int = Integer(topologydisassembly.nodes)
pt = Point(topologyartist.nodes)
num_7 = Number(edgeresults.length)
num_8 = Number(edgeresults_2.force)
col = Colour(graft)
data_3 = Data(topologydisassembly.edges)
crv = Curve(topologyartist.edges)

# ---- group: trail edges w/o aux
crv_2 = Curve(topologyartist_2.edges)

# ---- group: aux trails
crv_3 = Curve(python.auxiliary_trail)

# ---- group: deviation edges
crv_4 = Curve(topologyartist_2.deviation_edges)

# ----
crv_5 = Curve(topologyartist_2.loads)
brep = Brep(sph)
col_2 = Colour(item_2)
col_3 = Colour(cem_colors.color_auxiliary_trail)
col_4 = Colour(entwine_2)
col_5 = Colour(cem_colors.color_load)
num_9 = ClusterOutput(num_7)
num_10 = ClusterOutput(num_8)
col_6 = ClusterOutput(col)
crv_6 = ClusterOutput(crv_2)
crv_7 = ClusterOutput(crv_3)
crv_8 = ClusterOutput(crv_4)
crv_9 = ClusterOutput(crv_5)
brep_2 = ClusterOutput(brep)
col_7 = ClusterOutput(col_2)
col_8 = ClusterOutput(col_3)
col_9 = ClusterOutput(col_4)
crv_10 = ClusterOutput(crv)
col_10 = ClusterOutput(col_5)
data_4 = ClusterOutput(data_3)
pt_2 = ClusterOutput(pt)
int_2 = ClusterOutput(int)
